# Grasshopper definition geodesic.gh (Grasshopper 0.9.76)
# plug-ins: treesloth01, HoopSnake

r2 = Slider(10, range=0..10)
r1 = Slider(10, range=0..10)
pt = ConstructPoint(XCoordinate=0, YCoordinate=0, ZCoordinate=0)
pt_2 = Point(pt)
phi = GoldenRatio(Factor=r1)
xy = XYPlane(Origin=pt_2)
xz = XZPlane(Origin=pt_2)
yz = YZPlane(Origin=pt_2)
dom = Domain(DomainStart=expr("-x/2", phi), DomainEnd=expr("x/2", phi))
merge = Merge(Data1=xy, Data2=xz, Data3=yz)
dom_2 = Domain(DomainStart=expr("-x/2", r2), DomainEnd=expr("x/2", r2))
merge_2 = Merge(Data1=dom, Data2=dom_2, Data3=dom)
merge_3 = Merge(Data1=dom_2, Data2=dom, Data3=dom_2)
vec = VectorXYZ(XComponent=expr("x * 0.5", dom), YComponent=expr("x * 0.5", r2), ZComponent=0)  # -> Vector, Length
rectangle = Rectangle(Plane=merge, XSize=merge_2, YSize=merge_3, Radius=0)  # -> Rectangle, Length
move = Move(Geometry=pt_2, Motion=vec.Vector)  # -> Geometry, Transform
explode = Explode(Curve=rectangle.Rectangle, Recursive=True)  # -> Segments, Vertices
xy_2 = XYPlane(Origin=pt_2)
dist = Distance(PointA=pt_2, PointB=move.Geometry)
shift = ShiftList(List=explode.Vertices, Shift=1, Wrap=False)  # -> flatten(List)
int = Integer([0, 0, 0, 0, 0, 1, 1, 1, 2, 2, 2, 2, 2, 3, 3, 3, 4, 4, 5, 5])
int_2 = Integer([1, 4, 11, 10, 5, 9, 8, 4, 3, 7, 8, 9, 6, 10, 11, 7, 11, 7, 9, 6])
int_3 = Integer([5, 1, 4, 11, 10, 5, 9, 8, 6, 3, 7, 8, 9, 6, 10, 11, 7, 8, 6, 10])
sph = Sphere(Base=xy_2, Radius=dist)
item = ListItem(List=shift, Index=int, Wrap=True)
item_2 = ListItem(List=shift, Index=int_2, Wrap=True)
item_3 = ListItem(List=shift, Index=int_3, Wrap=True)
weave = Weave(Pattern=[0, 1, 2], Stream0=item, Stream1=item_2, Stream2=item_3, NullGaps=False)
subdivisions = Slider(3, range=0..5)
partition = PartitionList(List=weave, Size=3)
smaller = SmallerThan(FirstNumber=hs.IterationsCounter, SecondNumber=subdivisions)  # -> SmallerThan, OrEqualTo

hs = HoopSnake(
    StartingData=partition,
    Data=data,
    TerminationCondition=smaller.SmallerThan,
    Hoopsnake_Data_autoUpdate=False,
    Hoopsnake_Data_dataLimit=2147483647,
    Hoopsnake_Data_delay=0,
    Hoopsnake_Data_resetCounter=True,
    Hoopsnake_Data_updateView=True)  # -> Feedback, CumulativeFeedback, LoopsCounter, IterationsCounter

pline = PolyLine(Vertices=hs.Feedback, Closed=True)
item_4 = ListItem(List=hs.Feedback, Index=0, Wrap=True)  # -> Item, Item1, Item2
explode_2 = Explode(Curve=pline, Recursive=True)  # -> Segments, Vertices
srf4pt = _4PointSurface(CornerA=item_4.Item, CornerB=item_4.Item1, CornerC=item_4.Item2)
eval = EvaluateCurve(Curve=reparameterize(explode_2.Segments), Parameter=0.5)  # -> Point, Tangent, Angle
mesh = MeshBrep(
    Brep=srf4pt,
    Settings={GridMaxCount=0, GridMinCount=16, JaggedSeams=False, MaxEdgeLength=0, MinEdgeLength=0.0001, MinTolerance=0, Refine=True, RefineAngle=0, RelativeTolerance=0.65, SimplePlanes=True, Tolerance=0})
srf_cp = SurfaceClosestPoint(Point=eval.Point, Surface=sph)  # -> Point, UVPoint, Distance
item_5 = ListItem(List=hs.Feedback, Index=0, Wrap=True)  # -> Item, Item1, Item2
item_6 = ListItem(List=srf_cp.Point, Index=0, Wrap=True)  # -> Item, Item1, Item2
weave_2 = Weave(Pattern=[0, 1, 2], Stream0=item_5.Item, Stream1=item_6.Item, Stream2=item_6.Item2, NullGaps=False)
weave_3 = Weave(Pattern=[0, 1, 2], Stream0=item_5.Item1, Stream1=item_6.Item1, Stream2=item_6.Item, NullGaps=False)
weave_4 = Weave(Pattern=[0, 1, 2], Stream0=item_5.Item2, Stream1=item_6.Item2, Stream2=item_6.Item1, NullGaps=False)
weave_5 = Weave(Pattern=[0, 1, 2], Stream0=item_6.Item, Stream1=item_6.Item1, Stream2=item_6.Item2, NullGaps=False)
partition_2 = PartitionList(List=weave_2, Size=3)
partition_3 = PartitionList(List=weave_3, Size=3)
partition_4 = PartitionList(List=weave_4, Size=3)
partition_5 = PartitionList(List=weave_5, Size=3)
append_element = AppendElement(Data=partition_2, Index=0)
append_element_2 = AppendElement(Data=partition_3, Index=1)
append_element_3 = AppendElement(Data=partition_4, Index=2)
append_element_4 = AppendElement(Data=partition_5, Index=3)
merge_4 = Merge(Data1=append_element, Data2=append_element_2, Data3=append_element_3, Data4=append_element_4)  # -> simplify(Result)

data = Data(merge_4)
