# Grasshopper definition hoopsnake.gh (Grasshopper 0.9.76)
# plug-ins: HoopSnake

iterations = Slider(6, range=1..10)
value = Slider(2, range=1..10)
hs = HoopSnake(
    StartingData=value,
    Data=multiplication,
    TerminationCondition=smaller.SmallerThan,
    Hoopsnake_Data_autoUpdate=True,
    Hoopsnake_Data_dataLimit=2147483647,
    Hoopsnake_Data_delay=0,
    Hoopsnake_Data_resetCounter=False,
    Hoopsnake_Data_updateView=True)  # -> Feedback, CumulativeFeedback, LoopsCounter, IterationsCounter
multiplication = Multiplication(A=hs.Feedback, B=value)
smaller = SmallerThan(FirstNumber=hs.IterationsCounter, SecondNumber=iterations)  # -> SmallerThan, OrEqualTo
panel = Panel(hs.Feedback)
panel_2 = Panel(hs.LoopsCounter)
panel_3 = Panel(hs.IterationsCounter)
panel_4 = Panel(multiplication)
panel_5 = Panel(hs.CumulativeFeedback)
