# Grasshopper definition icosahedron.gh (Grasshopper 0.9.76)

r2 = Slider(10, range=0..10)
r1 = Slider(10, range=0..10)
phi = GoldenRatio(Factor=r1)
xy = XYPlane(Origin=Point(0, 0, 0))
xz = XZPlane(Origin=Point(0, 0, 0))
yz = YZPlane(Origin=Point(0, 0, 0))
dom = Domain(DomainStart=expr("-x/2", phi), DomainEnd=expr("x/2", phi))
merge = Merge(Data1=xy, Data2=xz, Data3=yz)
dom_2 = Domain(DomainStart=expr("-x/2", r2), DomainEnd=expr("x/2", r2))
merge_2 = Merge(Data1=dom, Data2=dom_2, Data3=dom)
merge_3 = Merge(Data1=dom_2, Data2=dom, Data3=dom_2)
rectangle = Rectangle(Plane=merge, XSize=merge_2, YSize=merge_3, Radius=0)  # -> Rectangle, Length
explode = Explode(Curve=rectangle.Rectangle, Recursive=True)  # -> Segments, Vertices
shift = ShiftList(List=explode.Vertices, Shift=1, Wrap=False)  # -> flatten(List)
int = Integer([0, 0, 0, 0, 0, 1, 1, 1, 2, 2, 2, 2, 2, 3, 3, 3, 4, 4, 5, 5])
int_2 = Integer([1, 4, 11, 10, 5, 9, 8, 4, 3, 7, 8, 9, 6, 10, 11, 7, 11, 7, 9, 6])
int_3 = Integer([5, 1, 4, 11, 10, 5, 9, 8, 6, 3, 7, 8, 9, 6, 10, 11, 7, 8, 6, 10])
item = ListItem(List=shift, Index=int, Wrap=True)
item_2 = ListItem(List=shift, Index=int_2, Wrap=True)
item_3 = ListItem(List=shift, Index=int_3, Wrap=True)
srf4pt = _4PointSurface(CornerA=item, CornerB=item_2, CornerC=item_3)
