# Grasshopper definition infection.gh (Grasshopper 0.9.76)
# plug-ins: treesloth01, HoopSnake

anchor_count = Slider(1000, range=0..1000)
seed = Slider(10, range=0..50)
crv = Curve(<curve referenced from the Rhino model>)
random = Random(Range=Domain(0, 0), Number=anchor_count, Seed=seed)
pop2d = Populate2D(Region=crv, Count=anchor_count, Seed=seed)
round = Round(Number=random)  # -> Nearest, Floor, Ceiling
iterations = Slider(200, range=0..1000)
bnd = Bounds2D(Coordinates=pop2d)
dedom2num = DeconstructDomain²(Domain=bnd)  # -> UMin, UMax, VMin, VMax
dom = ConstructDomain(DomainStart=dedom2num.UMin, DomainEnd=dedom2num.UMax)
dom_2 = ConstructDomain(DomainStart=dedom2num.VMin, DomainEnd=dedom2num.VMax)
xy = XYPlane(Origin=Point(0, 0, 0))
rectangle = Rectangle(Plane=xy, XSize=dom, YSize=dom_2, Radius=0)  # -> Rectangle, Length
merge = Merge(
    Data1=ColourSwatch(SwatchColor=RGB(230, 230, 230)),
    Data2=ColourSwatch(SwatchColor=RGB(0, 224, 101)),
    Data3=ColourSwatch(SwatchColor=RGB(159, 255, 69)))
voronoi = Voronoi(Points=pop2d, Boundary=rectangle.Rectangle, Plane=xy, BruteForceOverride=False)
boundary = BoundarySurfaces(Edges=voronoi)

# ---- group: Proximity Infection
prox = Proximity2D(Points=pop2d, Plane=PlaneXY(0, 0, 0), Group=5)  # -> Links, Topology

# ---- group: Spontaneous Infection
infection_probability = Slider(0.0001, range=0..1)
lng = ListLength(List=round.Nearest)

# ---- group: Growth
growth_probability = Slider(0.05, range=0..1)
lng_2 = ListLength(List=round.Nearest)

# ----
smaller = SmallerThan(FirstNumber=hs.IterationsCounter, SecondNumber=iterations)  # -> SmallerThan, OrEqualTo

# ---- group: Loop
hs = HoopSnake(
    StartingData=round.Nearest,
    Data=int,
    TerminationCondition=smaller.SmallerThan,
    Hoopsnake_Data_autoUpdate=False,
    Hoopsnake_Data_dataLimit=2147483647,
    Hoopsnake_Data_delay=0,
    Hoopsnake_Data_resetCounter=True,
    Hoopsnake_Data_updateView=True)  # -> Feedback, CumulativeFeedback, LoopsCounter, IterationsCounter

# ----
renumber = RenumberPaths(Data=hs.CumulativeFeedback)

# ---- group: Proximity Infection (continued)
item = ListItem(List=hs.Feedback, Index=prox.Topology, Wrap=True)
bnd_2 = Bounds(Numbers=item)  # -> flatten(Domain)
dedomain = DeconstructDomain(Domain=bnd_2)  # -> Start, End
equals = Equality(FirstNumber=dedomain.End, SecondNumber=2)  # -> Equality, Inequality

# ----
viewer = ParamViewer(renumber)

# ---- group: Spontaneous Infection (continued)
random_2 = Random(Range=Domain(0, 1), Number=lng, Seed=hs.IterationsCounter)
smaller_2 = SmallerThan(FirstNumber=random_2, SecondNumber=infection_probability)  # -> SmallerThan, OrEqualTo

# ----
replace = ReplacePaths(Data=renumber, Search=viewer, Replace=reverse(viewer))

# ---- group: Growth (continued)
random_3 = Random(Range=Domain(0, 1), Number=lng_2, Seed=hs.IterationsCounter)
smaller_3 = SmallerThan(FirstNumber=random_3, SecondNumber=growth_probability)  # -> SmallerThan, OrEqualTo

# ----
branch = TreeBranch(Tree=replace, Path=Slider(200, range=0..200), MaintainPaths=True)
item_2 = ListItem(List=merge, Index=branch, Wrap=True)
or = GateOr(A=smaller_2.SmallerThan, B=equals.Equality)

# ---- group: Replace
equals_2 = Equality(FirstNumber=hs.Feedback, SecondNumber=0)  # -> Equality, Inequality
equals_3 = Equality(FirstNumber=hs.Feedback, SecondNumber=1)  # -> Equality, Inequality
equals_4 = Equality(FirstNumber=hs.Feedback, SecondNumber=2)  # -> Equality, Inequality
and = GateAnd(A=equals_2.Equality, B=smaller_3.SmallerThan)
expression = Expression(x=hs.Feedback, y=and, Expression="if (y, 1, x)")
and_2 = GateAnd(A=equals_3.Equality, B=or)
expression_2 = Expression(x=expression, y=and_2, Expression="if (y, 2, x)")
expression_3 = Expression(x=expression_2, y=equals_4.Equality, Expression="if (y, 0, x)")

# ----
preview = CustomPreview(Geometry=boundary, Shader=item_2)

# ---- group: Loop (continued)
int = Integer(expression_3)
