# Grasshopper definition misc.gh (Grasshopper 0.9.76)

animate = Slider(1, range=0..1)

# ---- group: Animate
count = Slider(5, range=1..10)
num = Number()
division = Division(A=1, B=count)
series = Series(Start=0, Step=division, Count=count)
addition = Addition(A=series, B=division)
expression = Expression(x=series, Expression="Round(x, 3)")
expression_2 = Expression(x=addition, Expression="Round(x, 3)")
multiplication = Multiplication(A=num, B=count)
larger = LargerThan(FirstNumber=num, SecondNumber=expression)  # -> LargerThan, OrEqualTo
larger_2 = LargerThan(FirstNumber=num, SecondNumber=expression_2)  # -> LargerThan, OrEqualTo
mod = Modulus(A=multiplication, B=1)
addition_2 = Addition(A=larger.OrEqualTo, B=larger_2.OrEqualTo)
division_2 = Division(A=addition_2, B=2)
graph = GraphMapper(mod, x0=0, x1=1, y0=0, y1=1, container_name="Sine", Equation_px=[0, 1], Equation_py=[0, 1])
replace = ReplaceMembers(Set=division_2, Find=0.5, Replace=graph)  # -> flatten(Result)

# ---- group: Render Animation
reset = Button()
timer = Timer(TimerInterval=60, Target=c_script)  # disabled
int = Integer("20")
interval = Domain(int)
c_script = CSharpScript(interval=interval, reset=reset)  # -> out, B, C; inputs reset: Boolean; disabled
# ---------- c_script: C# ----------
    if(!reset){
      c++;
    }else{
      c = -1;
    }

    if(c >= interval.Min && c <= interval.Max){
      B = true;
    }else{
      B = false;
    }


    C = c;
# ---------- c_script: C# additional code ----------
  int c = -1;
# ---------- end c_script ----------
material = CreateMaterial(
    Diffuse=ColourSwatch(SwatchColor=RGB(191, 191, 191)),
    Specular=RGB(0, 0, 0),
    Emission=RGB(0, 0, 0),
    Transparency=0,
    Shine=0)
division_3 = Division(A=c_script.C, B=int)
c_script_2 = CSharpScript(material=material, activate=c_script.B, current=c_script.C, filePath="C:\Users\Jonas\Documents\<dir>")  # -> out; inputs geometry: list of GeometryBase, material: list, layers: list of String, activate: Boolean, current: Int32, filePath: String; disabled
# ---------- c_script_2: C# ----------
    if(!activate) return;

    List<Guid> guids = new List<Guid>();

    for(int i = 0; i < geometry.Count; i++){

      Rhino.DocObjects.ObjectAttributes att = new Rhino.DocObjects.ObjectAttributes();

      Rhino.Display.DisplayMaterial shader = new Rhino.Display.DisplayMaterial();

      if(material.Count == geometry.Count){
        shader = (Rhino.Display.DisplayMaterial) material[i];
      }else if(material.Count > 0){
        shader = (Rhino.Display.DisplayMaterial) material[0];
      }

      Rhino.DocObjects.Material mat = new Rhino.DocObjects.Material();

      mat.AmbientColor = shader.Ambient;
      mat.DiffuseColor = shader.Diffuse;
      mat.EmissionColor = shader.Emission;
      mat.Shine = shader.Shine;
      mat.SpecularColor = shader.Specular;
      mat.Transparency = shader.Transparency;

      string shaderName = string.Format("D{0}-E{1}-S{2}-Sp{3}-T{4}",
        shader.Diffuse.Name,
        shader.Emission.Name,
        shader.Shine,
        shader.Specular,
        shader.Transparency
        );

      mat.Name = shaderName;

      int nwMat = doc.Materials.Find(shaderName, true);
      if(nwMat < 0) nwMat = doc.Materials.Add(mat);

      Print(nwMat.ToString());

      string layer = "";

      if(layers.Count == geometry.Count){
        layer = layers[i];
      }else if(layers.Count > 0){
        layer = layers[0];
      }

      if(layer.Length == 0){
        att.MaterialSource = Rhino.DocObjects.ObjectMaterialSource.MaterialFromObject;
        att.MaterialIndex = nwMat;
        att.LayerIndex = doc.Layers.Find(doc.Layers.CurrentLayer.Id, true);
      }else{
        att.MaterialSource = Rhino.DocObjects.ObjectMaterialSource.MaterialFromLayer;
        int layInd = doc.Layers.Find(layer, true);
        if(layInd < 0){
          Rhino.DocObjects.Layer l = new Rhino.DocObjects.Layer();
          l.Color = mat.DiffuseColor;
          l.Name = layer;
          l.RenderMaterialIndex = nwMat;
          layInd = doc.Layers.Add(l);
        }
        att.LayerIndex = layInd;
      }

      Guid id = Guid.Empty;

      if(geometry[i].ObjectType == Rhino.DocObjects.ObjectType.Brep) id = doc.Objects.AddBrep((Brep) geometry[i], att);
      if(geometry[i].ObjectType == Rhino.DocObjects.ObjectType.Surface) id = doc.Objects.AddSurface((Surface) geometry[i], att);
      if(geometry[i].ObjectType == Rhino.DocObjects.ObjectType.Mesh) id = doc.Objects.AddMesh((Mesh) geometry[i], att);

      if(id.ToString().Length > 0) guids.Add(id);

    }

    string savedLocation = filePath + "\\r" + current.ToString("0000000") + ".png";

    Rhino.RhinoApp.RunScript("_-Render", false);
    Rhino.RhinoApp.RunScript("_-SaveRenderWindowAs \n\"" + savedLocation + "\"\n", false);
    Rhino.RhinoApp.RunScript("_-CloseRenderWindow", false);

    for(int i = 0; i < guids.Count; i++) doc.Objects.Delete(guids[i], true);
# ---------- end c_script_2 ----------

# ---- group: Approximate Curve
bool = Boolean()
crv = Curve(<curve referenced from the Rhino model>)
num_2 = Number()
divide = DivideCurve(Curve=crv, Count=num_2, Kinks=False)  # -> Points, Tangents, Parameters
lng = ListLength(List=divide.Points)
split = SplitList(List=divide.Points, Index=expr("x - 1", lng))  # -> ListA, ListB
split_2 = SplitList(List=divide.Points, Index=1)  # -> ListA, ListB
pdecon = Deconstruct(Point=split.ListA)  # -> XComponent, YComponent, ZComponent
pdecon_2 = Deconstruct(Point=split_2.ListB)  # -> XComponent, YComponent, ZComponent
not = GateNot(A=bool)
expression_3 = Expression(x=pdecon_2.ZComponent, y=pdecon.ZComponent, Expression="(x + y) / 2")
filter = StreamFilter(Gate=not, Stream0=pdecon_2.YComponent, Stream1=pdecon.YComponent)
filter_2 = StreamFilter(Gate=bool, Stream0=pdecon_2.XComponent, Stream1=pdecon.XComponent)
pt = ConstructPoint(XCoordinate=filter_2, YCoordinate=filter, ZCoordinate=expression_3)
ln = Line(StartPoint=pt, EndPoint=split_2.ListB)
ln_2 = Line(StartPoint=split.ListA, EndPoint=pt)
merge = Merge(Data1=ln, Data2=ln_2)
weave = Weave(Pattern=[0, 1], Stream0=divide.Points, Stream1=pt, NullGaps=False)
join = JoinCurves(Curves=merge, Preserve=False)

# ---- group: 2 Point Box
vec = Vector()
pt_2 = Point(Point(7, 0, 2))
pt_3 = Point(Point(-5, 24, 0))
num_3 = Number()
num_4 = Number()
toggle_end_type = BooleanToggle(False)
dist = Distance(PointA=pt_2, PointB=pt_3)  # -> expr("x * 0.5", Distance)
vec2pt = Vector2Pt(PointA=pt_2, PointB=pt_3, Unitize=False)  # -> Vector, Length
amp = Amplitude(Vector=vec2pt.Vector, Amplitude=dist)
filter_3 = StreamFilter(Gate=toggle_end_type, Stream0=num_3, Stream1=num_4)
move = Move(Geometry=pt_2, Motion=amp)  # -> Geometry, Transform
addition_3 = Addition(A=dist, B=filter_3)
pl = ConstructPlane(Origin=move.Geometry, XAxis=vec2pt.Vector, YAxis=vec)
box = CenterBox(Base=pl, X=addition_3, Y=num_4, Z=num_3)

# ----
graph_2 = GraphMapper(x0=0, x1=1, y0=0, y1=1, container_name="Parabola", Ox=0.5011587739, Oy=1, Px=1, Py=0)
swatch = ColourSwatch(SwatchColor=RGB(200, 200, 200))
swatch_2 = ColourSwatch(SwatchColor=RGB(220, 220, 220))
swatch_3 = ColourSwatch(SwatchColor=RGBA(255, 0, 0, 102))
swatch_4 = ColourSwatch(SwatchColor=RGBA(0, 255, 0, 102))
lerp = Expression(Expression="(1 - t) * a + t * b")
swatch_5 = ColourSwatch(SwatchColor=RGBA(0, 0, 255, 102))
list_paths = VBScript(TooltipDescriptionOverride="List all the paths in a data tree.", TooltipTextOverride="List Paths")  # -> P; inputs D: tree
# ---------- list_paths: C# ----------
    P = D.Paths
# ---------- end list_paths ----------
gradient = Gradient(LowerLimit=0, UpperLimit=1, Parameter=graph_2, stops=[0: RGB(220, 220, 220), 1: RGB(255, 150, 150)])
gradient_2 = Gradient(LowerLimit=0, UpperLimit=1, stops=[0: RGB(220, 220, 220), 1: RGB(150, 230, 150)])
gradient_3 = Gradient(LowerLimit=0, UpperLimit=1, stops=[0: RGB(220, 220, 220), 1: RGB(150, 150, 255)])
swatch_6 = ColourSwatch(SwatchColor=RGB(0, 0, 0))
swatch_7 = ColourSwatch(SwatchColor=RGB(89, 89, 89))
vb = VBScript()  # -> out, A; inputs msh: Mesh
# ---------- vb: C# ----------
    msh.Vertices.CullUnused
    A = msh
# ---------- end vb ----------
multiplication_2 = Multiplication(A=animate, B=-1)
addition_4 = Addition(A=multiplication_2, B=1)
filter_4 = StreamFilter(Gate=Toggle(True), Stream0=animate, Stream1=addition_4)
