# Grasshopper definition mobius.gh (Grasshopper 0.9.76)

md_slider = MDSlider(
    slider_value=Point(0.7419511749, 0.8668291045, 0.5),
    SliderMode=0,
    x_domain=Domain(0, 10),
    y_domain=Domain(0, 10),
    z_domain=Domain(0, 1))
md_slider_2 = MDSlider(
    slider_value=Point(0.7014031759, 0.1611309517, 0.5),
    SliderMode=0,
    x_domain=Domain(0, 5),
    y_domain=Domain(0, 5),
    z_domain=Domain(0, 1))
yz = YZPlane(Origin=Point(0, 0, 0))
pdecon = Deconstruct(Point=md_slider)  # -> XComponent, YComponent, ZComponent
guides = Slider(39, range=0..100)
invert = Slider(180, range=0..180)
ellipse = Ellipse(Plane=yz, Radius1=pdecon.XComponent, Radius2=pdecon.YComponent)  # -> Ellipse, Focus1, Focus2
num = Number(180)
pframes = PerpFrames(Curve=ellipse.Ellipse, Count=guides, Align=True)  # -> Frames, Parameters
division = Division(A=num, B=guides)
item = ListItem(List=pframes.Frames, Index=0, Wrap=True)
ins = InsertItems(List=reverse(pframes.Frames), Item=item, Indices=0, Wrap=True)
series = Series(Start=invert, Step=division, Count=expr("x + 1", guides))
prot = RotatePlane(Plane=ins, Angle=degrees(series))
pdecon_2 = Deconstruct(Point=md_slider_2)  # -> XComponent, YComponent, ZComponent
ellipse_2 = Ellipse(Plane=prot, Radius1=pdecon_2.XComponent, Radius2=pdecon_2.YComponent)  # -> Ellipse, Focus1, Focus2
loft = Loft(
    Curves=ellipse_2.Ellipse,
    Options={Adjust=False, Closed=False, LoftEnds=0, LoftSimp=0, LoftType=0, Rebuild=10, Refit=0.01})
mesh = MeshBrep(
    Brep=loft,
    Settings={GridMaxCount=0, GridMinCount=16, JaggedSeams=False, MaxEdgeLength=0, MinEdgeLength=0.0001, MinTolerance=0, Refine=True, RefineAngle=0, RelativeTolerance=0.65, SimplePlanes=True, Tolerance=0})
preview = CustomPreview(Geometry=mesh, Shader=ColourSwatch(SwatchColor=RGB(181, 184, 201)))
