# Grasshopper definition reaction-diffusion.gh (Grasshopper 0.9.76)
# plug-ins: treesloth01, HoopSnake

# Reaction-diffusion chemical simulation: http://www.karlsims.com/rd.html
# 
# Currently broken, A/B values extend beyond the valid 0-1 range after several iterations.
anchor_count = Slider(1000, range=0..1000)
seed = Slider(10, range=0..50)
crv = Curve(<curve referenced from the Rhino model>)
int = Integer(0)
pt = ConstructPoint(XCoordinate=0, YCoordinate=0, ZCoordinate=0)
dup = DuplicateData(Data=int, Number=anchor_count, Order=True)
random = Random(Range=Domain(0, 0.51), Number=anchor_count, Seed=seed)
pop2d = Populate2D(Region=crv, Count=anchor_count, Seed=seed)
cps = ClosestPoints(Point=pt, Cloud=pop2d, Count=10)  # -> ClosestPoint, CPIndex, Distance
replace = ReplaceItems(List=dup, Item=1, Indices=cps.CPIndex, Wrap=False)
round = Round(Number=random)  # -> Nearest, Floor, Ceiling
iterations = Slider(200, range=0..1000)
vec = VectorXYZ(XComponent=1, YComponent=replace, ZComponent=0)  # -> Vector, Length
number_slider = Slider(8, range=1..20)
bnd = Bounds2D(Coordinates=pop2d)
prox = Proximity2D(Points=pop2d, Plane=PlaneXY(0, 0, 0), Group=number_slider)  # -> Links, Topology
dedom2num = DeconstructDomain²(Domain=bnd)  # -> UMin, UMax, VMin, VMax
dom = ConstructDomain(DomainStart=dedom2num.UMin, DomainEnd=dedom2num.UMax)
dom_2 = ConstructDomain(DomainStart=dedom2num.VMin, DomainEnd=dedom2num.VMax)
xy = XYPlane(Origin=Point(0, 0, 0))
rectangle = Rectangle(Plane=xy, XSize=dom, YSize=dom_2, Radius=0)  # -> Rectangle, Length
a_diffusion_rate = Slider(1, range=0..1)
b_diffusion_rate = Slider(0.5, range=0..1)
feed_rate = Slider(0.055, range=0..1)
kill_rate = Slider(0.062, range=0..1)
voronoi = Voronoi(Points=pop2d, Boundary=rectangle.Rectangle, Plane=xy, BruteForceOverride=False)
boundary = BoundarySurfaces(Edges=voronoi)
delta_time = Slider(1, range=0..2)
precision = Slider(5, range=0..10)
pow = Power(A=10, B=precision)
smaller = SmallerThan(FirstNumber=hs.IterationsCounter, SecondNumber=iterations)  # -> SmallerThan, OrEqualTo

# ---- group: Loop
hs = HoopSnake(
    StartingData=vec.Vector,
    Data=data,
    TerminationCondition=smaller.SmallerThan,
    Hoopsnake_Data_autoUpdate=False,
    Hoopsnake_Data_dataLimit=2147483647,
    Hoopsnake_Data_delay=0,
    Hoopsnake_Data_resetCounter=True,
    Hoopsnake_Data_updateView=True)  # -> Feedback, CumulativeFeedback, LoopsCounter, IterationsCounter

# ----
renumber = RenumberPaths(Data=hs.CumulativeFeedback)
devec = DeconstructVector(Vector=hs.Feedback)  # -> XComponent, YComponent, ZComponent
viewer = ParamViewer(renumber)
item = ListItem(List=devec.XComponent, Index=prox.Topology, Wrap=True)
item_2 = ListItem(List=devec.YComponent, Index=prox.Topology, Wrap=True)
replace_2 = ReplacePaths(Data=renumber, Search=viewer, Replace=reverse(viewer))
ma = MassAddition(Input=item)  # -> flatten(Result), PartialResults
ma_2 = MassAddition(Input=item_2)  # -> flatten(Result), PartialResults
branch = TreeBranch(Tree=replace_2, Path=Slider(0, range=0..200), MaintainPaths=True)
division = Division(A=ma.Result, B=number_slider)
division_2 = Division(A=ma_2.Result, B=number_slider)
devec_2 = DeconstructVector(Vector=hs.Feedback)  # -> XComponent, YComponent, ZComponent
subtraction = Subtraction(A=division, B=devec.XComponent)
subtraction_2 = Subtraction(A=division_2, B=devec.YComponent)
gradient = Gradient(LowerLimit=0, UpperLimit=1, Parameter=devec_2.YComponent, stops=[0: RGB(255, 255, 255), 1: RGB(0, 0, 0)])
preview = CustomPreview(Geometry=boundary, Shader=gradient)
expression = Expression(a=devec.XComponent, f=feed_rate, Expression="f  * (1 - a)")
expression_2 = Expression(b=devec.YComponent, f=feed_rate, k=kill_rate, Expression="(k + f) * b")
expression_3 = Expression(a=devec.XComponent, b=devec.YComponent, Expression="a * b * b")
multiplication = Multiplication(A=a_diffusion_rate, B=subtraction)
multiplication_2 = Multiplication(A=b_diffusion_rate, B=subtraction_2)
subtraction_3 = Subtraction(A=multiplication, B=expression_3)
addition = Addition(A=multiplication_2, B=expression_3)
sort = SortList(Keys=expression_3, ValuesA=expression_3)  # -> Keys, ValuesA
sort_2 = SortList(Keys=expression_2, ValuesA=expression_2)  # -> Keys, ValuesA
addition_2 = Addition(A=subtraction_3, B=expression)
subtraction_4 = Subtraction(A=addition, B=expression_2)
multiplication_3 = Multiplication(A=subtraction_4, B=delta_time)
addition_3 = Addition(A=devec.YComponent, B=multiplication_3)
multiplication_4 = Multiplication(A=addition_2, B=delta_time)
addition_4 = Addition(A=devec.XComponent, B=multiplication_4)
multiplication_5 = Multiplication(A=addition_4, B=pow)
multiplication_6 = Multiplication(A=addition_3, B=pow)
round_2 = Round(Number=multiplication_5)  # -> Nearest, Floor, Ceiling
round_3 = Round(Number=multiplication_6)  # -> Nearest, Floor, Ceiling
division_3 = Division(A=round_3.Nearest, B=pow)
division_4 = Division(A=round_2.Nearest, B=pow)
vec_2 = VectorXYZ(XComponent=division_4, YComponent=division_3, ZComponent=0)  # -> Vector, Length

# ---- group: Loop (continued)
data = Data(vec_2.Vector)
