# Grasshopper definition waffle-2.gh (Grasshopper 0.9.76)

contour_angle = Slider(111.802, range=0.001..180)
contour_size = Slider(13.133, range=1..20)
thickness = Slider(2, range=0.1..2)
addition = Addition(A=contour_angle, B=90)
merge = Merge(Data1=addition, Data2=contour_angle)
merge_2 = Merge(Data1=addition, Data2=contour_angle)
surface_a = Surface(<surface referenced from the Rhino model>)
surface_b = Surface(<surface referenced from the Rhino model>)
vrot = Rotate(Vector=Vector(0, 1, 0), Axis=Vector(0, 0, 1), Angle=expr("Rad(x)", merge))  # -> simplify(Vector)
vrot_2 = Rotate(Vector=Vector(0, 1, 0), Axis=Vector(0, 0, 1), Angle=expr("Rad(x)", merge_2))  # -> simplify(Vector)
area = Area(Geometry=surface_b)  # -> Area, Centroid
contour = Contour(Shape=surface_a, Point=area.Centroid, Direction=vrot, Distance=contour_size)
contour_2 = Contour(Shape=surface_b, Point=area.Centroid, Direction=vrot_2, Distance=contour_size)
item = ListItem(List=vrot_2, Index=0, Wrap=True)  # -> Item, Item1
trim = TrimTree(Tree=contour, Depth=1)
bang = ExplodeTree(Data=trim)  # -> Branch0, Branch1
ccx = CurveCurve(CurveA=graft(bang.Branch0), CurveB=bang.Branch1)  # -> Points, ParamsA, ParamsB
trim_2 = TrimTree(Tree=contour_2, Depth=1)
bang_2 = ExplodeTree(Data=trim_2)  # -> Branch0, Branch1
ccx_2 = CurveCurve(CurveA=graft(bang_2.Branch0), CurveB=bang_2.Branch1)  # -> Points, ParamsA, ParamsB
dist = Distance(PointA=ccx.Points, PointB=ccx_2.Points)  # -> expr("x / 2", Distance)
dom = Domain(DomainStart=expr("-x/2", thickness), DomainEnd=expr("x/2", thickness))
plane_a = Plane(Origin=ccx.Points, XAxis=item.Item1, YAxis=Vector(0, 0, 1))
plane_b = Plane(Origin=ccx_2.Points, XAxis=item.Item, YAxis=Vector(0, 0, 1))
rulesrf = RuledSurface(CurveA=trim, CurveB=trim_2)
dom_2 = ConstructDomain(DomainStart=expr("x * -1", dist), DomainEnd=dist)
edges = BrepEdges(Brep=rulesrf)  # -> Naked, Interior, NonManifold
rectangle = Rectangle(Plane=plane_a, XSize=dom, YSize=dom_2, Radius=0)  # -> Rectangle, Length
rectangle_2 = Rectangle(Plane=plane_b, XSize=dom, YSize=dom_2, Radius=0)  # -> Rectangle, Length
join = JoinCurves(Curves=edges.Naked, Preserve=False)  # -> simplify(Curves)
path_mapper = PathMapper(rectangle_2.Rectangle, source="{a;b;c}(i)", target="{a;c;b}(i)")
trim_3 = TrimTree(Tree=join, Depth=1)
trim_4 = TrimTree(Tree=rectangle.Rectangle, Depth=1)  # -> simplify(Tree)
trim_5 = TrimTree(Tree=path_mapper, Depth=1)  # -> simplify(Tree)
bang_3 = ExplodeTree(Data=trim_3)  # -> Branch0, Branch1
trim_6 = TrimWithRegions(Curve=graft(bang_3.Branch0), Regions=trim_4)  # -> Inside, Outside
trim_7 = TrimWithRegions(Curve=trim_4, Regions=graft(bang_3.Branch0))  # -> Inside, Outside
trim_8 = TrimWithRegions(Curve=graft(bang_3.Branch1), Regions=trim_5)  # -> Inside, Outside
trim_9 = TrimWithRegions(Curve=trim_5, Regions=graft(bang_3.Branch1))  # -> Inside, Outside
merge_3 = Merge(Data1=trim_6.Outside, Data2=trim_7.Inside)
merge_4 = Merge(Data1=trim_8.Outside, Data2=trim_9.Inside)
join_2 = JoinCurves(Curves=flatten(merge_3), Preserve=False)  # -> simplify(flatten(Curves))
join_3 = JoinCurves(Curves=flatten(merge_4), Preserve=False)  # -> simplify(flatten(Curves))
planar = PlanarSrf(Edges=join_2)
planar_2 = PlanarSrf(Edges=join_3)
